# Grasshopper definition PrefactibilidadEconomica_UsoMixto y estacionamiento- Mexico y Volumetria, usos mixtos, Estacionamiento, Vivienda_Caso San Pedro.gh (Grasshopper 1.0.8)
# Copyright: Samuel Rodriguez y Andres Obregón
# Copyright: Samuel Rodriguez Matus
# Copyright: Samuel Rodriguez
# Copyright: Copyright © [2024] [Andres Obregon Lopez or UDEM]. All rights reserved.
# plug-ins: Bifocals

costo_de_vivienda_por_m2_de_construcción = ValueList({"Interes Social": 9800, "Interés Medio": 14100, "Semi Lujo": 20300, "Lujo": 27900}, selected="Interés Medio")
altura_de_entrepiso = Slider(3, range=3..4)
número_de_pisos = Slider(4, range=0..15)

# ---- group: Curva de Terreno
curve = Curve(<curve referenced from the Rhino model>)

# ---- group: Cluster
preliminares_de_terreno = InformaciónDeTerreno(curva_de_terreno=curve, parametro_retiros=Slider(0, range=0..3), retiro_via=Slider(1.9, range=0..10))  # -> terreno_2, area_de_retiro_2, curva_de_retiros_2

# ----
en_que_distrito_se_encuentra_el_proyecto = ValueList({"#Distrito Centro# --------------": "#Distrito Centro#", "Distrito Centro": 1, "Distrito Industrial": 1, "Distrito Mitras Centro": 2.3, "Distrito Obispado": 2.3, "#Distrito Poniente# ------------": "#Distrito Poniente#", "Distrito San Jerónimo": 2.3, "Distrito Cumbres": 2.3, "Distrito Cumbres Poniente.": 2.3, "#Distrito Norte# ---------------": "#Distrito Norte#", "Distrito Distrito Cd. Solidaridad": 1.5, "Distrito Mitras Norte": 2, "Distrito San Bernabé": 1.5, "Distrito Valle Verde": 2, "#Distrito Sur# -----------------": "#Distrito Sur#", "Distrito Garza Sada": 2.3, "Distrito Independencia": 2, "Distrito Lázaro Cárdenas": 2.3, "Distrito Satelite": 2.3}, selected="Distrito Industrial")
value_list = ValueList({"Estacionamiento Subterraneo": 0, "Estacionamiento en Niveles": 1}, selected="Estacionamiento Subterraneo")
definir_coeficientes_cos_cas_cus = ValueList({"D1": "0.4""0.1""0.7", "D2": "0.5""0.3""0.7", "D3": "0.6""0.25""1.2", "D4": "0.6""0.2""1.2", "D5": "0.7""0.15"1.4", "D6": "0.7""0.15""1.5", "D7": "0.75""0.13""1.7", "D8": "0.75""0.13""2", "D9": "0.75""0.13""2.5", "D10": "0.75""0.15""3", "D11": "0.75""0.15""5", "D12": "0.8""0.1""100"}, selected="D8")
porcentaje_de_circulcion = ValueList({"Vivienda Tipo Interes Social": 0.12, "Vivienda Tipo Interes Medio": 0.18, "Vivienda Tipo Semi Lujo.": 0.22, "Vivienda Tipo Lujo": 0.28}, selected="Vivienda Tipo Interes Medio")
quieres_generar_el_reporte_excel = BooleanToggle(True)
tipo_de_estacionamiento = ValueList({"Estacionamiento Subterraneo": 8000, "Estacionamiento en Niveles": 5500}, selected="Estacionamiento Subterraneo")
el_proyecto_requerira_demolicion = BooleanToggle(True)
el_proyecto_tendrá_estacionamiento = BooleanToggle(True)
quieres_correr_la_simulación = BooleanToggle(True)
el_proyecto_tendrá_comercio = BooleanToggle(True)
número_de_locales = Slider(10, range=0..10)

# ---- group: Costo Por M2 de Construccion
costo_x_m2_construccion = CostoPorM2DeConstruccion(tipo_de_vivienda=costo_de_vivienda_por_m2_de_construcción)

# ----
en_que_delegación = ValueList({"Delegación Centro": "centro", "Delegación Poniente": "poniente", "Delegación Norte": "norte", "Delegación Sur": "sur"}, selected="Delegación Centro")
niveles_comercio = Slider(2, range=0..5)
no_de_viviendas = Slider(5, range=0..100)
curva_de_retiros = Curve(preliminares_de_terreno.curva_de_retiros_2)
dirección_dondese_guardara_el_reporte_ex = Panel("D:\Tesis_MAA\Reportes")  # "Dirección dondese guardara el Reporte Excel"

# ---- group: Definición Tipo de Estacionamiento
estacionamiento = DefiniciónTipoDeEstacionamiento(tipo_de_estacionamiento=value_list)

# ----
panel = Panel(preliminares_de_terreno.terreno_2)
costo_de_terreno_por_m2 = Panel("8000")
altura_entrepisos_estacionamiento = Slider(3, range=3..4.5)
cos_cus_cas = COEFICIENTESCOSCUSCAS(normativa=definir_coeficientes_cos_cas_cus)  # -> cos_2, cas_2, cus_2
costo_de_venta_por_m2 = Panel("25000")
altura_entrepisos_vivienda = Slider(3, range=3..4.5)
circulacion = Panel(porcentaje_de_circulcion)
altura_de_de_usos_mixtos = Slider(3, range=0..5)
remetimiento_posterior = Slider(3, range=0..10)
remetimiento_frontal = Slider(6, range=0..10)
área_de_retiro = Panel(preliminares_de_terreno.area_de_retiro_2)
iva = Panel(".16")
panel_2 = Panel(cos_cus_cas.cas_2)
crv_terreno = Data(preliminares_de_terreno.terreno_2)
comercio = Data(el_proyecto_tendrá_comercio)
costo_por_m2_de_construcción = Panel(costo_x_m2_construccion)
cus = Panel(cos_cus_cas.cus_2)
cosro_de_local_por_m2 = Panel("15000")
área_de_demolición = Panel("150")
frente_de_terreno = Curve(<curve referenced from the Rhino model>)
utilidad_deseada = Panel("15")
numero_de_niveles = Data(número_de_pisos)
niveles_comercio_2 = Data(niveles_comercio)
cos = Panel(cos_cus_cas.cos_2)
cas = Panel(cos_cus_cas.cas_2)
panel_3 = Panel(cos_cus_cas.cos_2)
panel_4 = Panel(cos_cus_cas.cus_2)
number = Number(circulacion)
prefactibilidad_economica_mty_2025 = Python3Script(
    area_terreno=preliminares_de_terreno.terreno_2,
    valor_terreno=costo_de_terreno_por_m2,
    area_retiros=área_de_retiro,
    curva_retiros=curva_de_retiros,
    COS=panel_3,
    CAS=panel_2,
    CUS=panel_4,
    Altura_Entrepisos=altura_de_entrepiso,
    Num_Niveles=número_de_pisos,
    areaCirculacionPorcentaje=number,
    costoMetroConstruccion=costo_por_m2_de_construcción,
    Costo_de_venta_m2=costo_de_venta_por_m2,
    correrSimulacion=quieres_correr_la_simulación,
    utilidadDeseada=utilidad_deseada,
    IVA=iva,
    demolicion=el_proyecto_requerira_demolicion,
    area_demolicion=área_de_demolición,
    usos_mixtos=el_proyecto_tendrá_comercio,
    num_locales=número_de_locales,
    costo_local_m2=cosro_de_local_por_m2,
    estacionamiento=el_proyecto_tendrá_estacionamiento,
    tipo_estacionamiento=tipo_de_estacionamiento,
    delegacion=en_que_delegación,
    n_viviendas=no_de_viviendas,
    Niveles_Comercio=niveles_comercio,
    Distrito=en_que_distrito_se_encuentra_el_proyecto,
    Reporte_excel=quieres_generar_el_reporte_excel,
    ruta_carpeta=dirección_dondese_guardara_el_reporte_ex)  # -> out, Area_de_terreno, Valor_del_terreno, Costo_de_demolicion, area_neta, COS_m2, CAS_m2, CUS_m2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; inputs area_terreno: Surface, valor_terreno: Double, area_retiros: Double, curva_retiros: Curve, COS: Double, CAS: Double, CUS: Double, Altura_Entrepisos: Double, Num_Niveles: tree of Int32, costoMetroConstruccion: Double, Costo_de_venta_m2: Double, correrSimulacion: Boolean, utilidadDeseada: Double, IVA: Double, demolicion: Boolean, area_demolicion: Int32, usos_mixtos: Boolean, num_locales: Int32, costo_local_m2: Double, estacionamiento: Boolean, tipo_estacionamiento: list of Double, delegacion: list of String, n_viviendas: Int32, Niveles_Comercio: Int32, Distrito: list of Double, Reporte_excel: Boolean, ruta_carpeta: String
# ---------- prefactibilidad_economica_mty_2025: Python ----------
import Rhino.Geometry as rg
import math
import csv, os

# ================================================================
# DESEMPACADOR UNIVERSAL DE INPUTS DE GRASSHOPPER
# Maneja: DataTree, GH_Integer, GH_Number, GH_Boolean,
#         listas, tuplas y valores Python nativos.
# ================================================================
def _gh(v):
    if hasattr(v, 'Branches'):
        branches = list(v.Branches)
        if branches:
            branch = list(branches[0])
            if branch:
                v = branch[0]
    if isinstance(v, (list, tuple)):
        v = v[0]
    if hasattr(v, 'Value'):
        v = v.Value
    return v

def _f(v):  return float(_gh(v))
def _i(v):  return int(_gh(v))
def _b(v):
    val = _gh(v)
    if isinstance(val, bool):    return val
    if hasattr(val, '__bool__'): return bool(val)
    return bool(val)
def _s(v):  return str(_gh(v)).strip()

def _to_list(v):
    if hasattr(v, 'Branches'):
        result = []
        for branch in v.Branches:
            for item in branch:
                result.append(_gh(item))
        return result
    if isinstance(v, (list, tuple)):
        return [_gh(x) for x in v]
    return [_gh(v)]

# ================================================================
# CONVERSIÓN DE TODOS LOS INPUTS
# ================================================================
valor_terreno             = _f(valor_terreno)
Num_Niveles               = _i(Num_Niveles)
COS                       = _f(COS)
CAS                       = _f(CAS)
CUS                       = _f(CUS)
Altura_Entrepisos         = _f(Altura_Entrepisos)
area_retiros              = _f(area_retiros)
costoMetroConstruccion    = _f(costoMetroConstruccion)
Costo_de_venta_m2         = _f(Costo_de_venta_m2)
areaCirculacionPorcentaje = _f(areaCirculacionPorcentaje)
IVA                       = _f(IVA)
utilidadDeseada           = _f(utilidadDeseada)
n_viviendas               = _f(n_viviendas)
demolicion                = _b(demolicion)
usos_mixtos               = _b(usos_mixtos)
estacionamiento           = _b(estacionamiento)
correrSimulacion          = _b(correrSimulacion)
Reporte_excel             = _b(Reporte_excel)

if Num_Niveles <= 0:
    raise ValueError("Num_Niveles debe ser mayor a 0.")

# ================================================================
# ÁREA DEL TERRENO
# ================================================================
try:
    _geo  = _gh(area_terreno)
    props = rg.AreaMassProperties.Compute(_geo)
    area_value = props.Area
except Exception as e:
    raise ValueError("area_terreno no es una superficie valida: {}".format(e))

Area_de_terreno = "{:.2f} m2".format(area_value)
print("Area_terreno = {:.2f} m2".format(area_value))

# ================================================================
# VALOR DEL TERRENO
# ================================================================
total_value       = area_value * valor_terreno
Valor_del_terreno = "${:.2f} mxn".format(total_value)
print("Valor del Terreno = {:.2f} mxn".format(total_value))

# ================================================================
# ÁREA NETA
# ================================================================
area_neta = area_value - area_retiros
print("Area Util = {:.2f} m2".format(area_neta))

# ================================================================
# DEMOLICIÓN
# ================================================================
if demolicion:
    area_demolicion     = _f(area_demolicion)
    total_dem           = area_demolicion * 1600 + area_value * 15 + area_value * 0.15
    Costo_de_demolicion = "${:.2f} mxn".format(total_dem)
    print("Costo demolicion = {:.2f} mxn".format(total_dem))
else:
    total_dem           = 0.0
    Costo_de_demolicion = "$0.00 mxn"

# ================================================================
# NORMATIVA (COS / CAS / CUS)
# ================================================================
cos_area = area_value * COS
cas_area = area_value * CAS
cus_area = area_value * CUS
COS_m2   = "{:.2f} m2 COS".format(cos_area)
CAS_m2   = "{:.2f} m2 CAS".format(cas_area)
CUS_m2   = "{:.2f} m2 CUS".format(cus_area)
print("{:.2f} m2 COS".format(cos_area))
print("{:.2f} m2 CAS".format(cas_area))
print("{:.2f} m2 CUS".format(cus_area))

# ================================================================
# NIVELES Y HUELLA DEL EDIFICIO
# Huella = CUS / Num_Niveles  →  mas pisos = menor huella
# ================================================================
huella_edificio       = cus_area / Num_Niveles
Huella_Edificio_m2    = "{:.2f} m2 huella por nivel".format(huella_edificio)
Altura_Total_Proyecto = Num_Niveles * Altura_Entrepisos
Altura_Total_str      = "{:.2f} mts altura total del proyecto".format(Altura_Total_Proyecto)

print("{:.2f} mts altura total estimada".format(Altura_Total_Proyecto))

if huella_edificio > cos_area:
    niveles_minimos = math.ceil(cus_area / cos_area)
    Huella_Estatus  = (
        "ADVERTENCIA: Huella ({:.2f} m2) supera COS ({:.2f} m2). "
        "Minimo recomendado: {} niveles.".format(
            huella_edificio, cos_area, niveles_minimos)
    )
else:
    pct            = (huella_edificio / cos_area) * 100
    Huella_Estatus = (
        "OK: Huella valida {:.2f} m2 ({:.1f}% del COS). "
        "Disponible: {:.2f} m2".format(
            huella_edificio, pct, cos_area - huella_edificio)
    )
print(Huella_Estatus)

# ================================================================
# USOS MIXTOS
# ================================================================
if usos_mixtos:
    num_locales       = _i(num_locales)
    costo_local_m2    = _f(costo_local_m2)
    area_local        = cos_area / num_locales
    venta_local       = area_local * costo_local_m2

    iter_locales      = 0
    ingreso_local_tot = 0.0
    max_iter_locales  = 100000

    while iter_locales < num_locales and iter_locales < max_iter_locales:
        ingreso_local_tot += venta_local
        iter_locales      += 1

    if iter_locales >= max_iter_locales:
        raise RuntimeError("Demasiados locales; revisa num_locales")

    area_comercio = cos_area
else:
    num_locales       = 0
    iter_locales      = 0
    area_local        = 0.0
    venta_local       = 0.0
    ingreso_local_tot = 0.0
    area_comercio     = 0.0

print("Numero de Locales: {:.2f}".format(num_locales))
print("Area de local: {:.2f} m2".format(area_local))
print("Costo de venta de local: ${:.2f} m2".format(venta_local))
print("Ingreso de locales: ${:.2f} mxn".format(ingreso_local_tot))
print("Total de iteraciones locales: {:.2f}".format(iter_locales))

Area_de_local      = "{:.2f} m2 local".format(area_local)
Venta_de_local     = "${:.2f} mxn por local".format(venta_local)
Ingreso_de_locales = "${:.2f} mxn total por locales".format(ingreso_local_tot)

# ================================================================
# ÁREA DE CIRCULACIÓN
# ================================================================
area_circulacion = cus_area * areaCirculacionPorcentaje
print("Area circulacion ({:.0f}%): {:.2f} m2".format(areaCirculacionPorcentaje * 100, area_circulacion))

# ================================================================
# ESTACIONAMIENTO
# ================================================================
FACTORES = {
    'centro'  : {'comercial': 35},
    'poniente': {'comercial': 25},
    'norte'   : {'comercial': 30},
    'sur'     : {'comercial': 25}
}
M2_CAJON    = 2.5 * 5
FACTOR_VIAL = 1.50

cajones_vivienda  = []
cajones_comercio  = []
cajones_total     = []
area_m2           = []   # nombre original mantenido
costo_estac_total = []
_costo_estac_num  = []

_tipo_est      = _gh(tipo_estacionamiento)
if hasattr(_tipo_est, 'Value'):
    _tipo_est  = _tipo_est.Value
costo_unitario = float(_tipo_est)

if estacionamiento:
    delegaciones = [str(d).strip().lower() for d in _to_list(delegacion)]
    distritos    = [float(d) for d in _to_list(Distrito)]

    for dep, fac in zip(delegaciones, distritos):
        regs = FACTORES.get(dep, {'comercial': 30})
        cv   = n_viviendas * fac
        cc   = (cos_area - area_circulacion) / regs['comercial'] if cos_area else 0
        tot  = math.ceil(cv + cc)
        am2  = tot * M2_CAJON * FACTOR_VIAL
        cost = am2 * costo_unitario
        cajones_vivienda.append(round(cv, 2))
        cajones_comercio.append(round(cc, 2))
        cajones_total.append(tot)
        area_m2.append(int(round(am2)))          # lista de outputs
        costo_estac_total.append("$ {:,}.mxn".format(int(round(cost))))
        _costo_estac_num.append(cost)

    # Valor numérico total para cálculos posteriores y para pasar al Script 2
    _am2_num = sum(area_m2)
else:
    _am2_num         = 0
    _costo_estac_num = [0.0]

# ================================================================
# FACTIBILIDAD ECONÓMICA
# ================================================================
Costo_por_m2_construccion = "Costo m2 construccion: ${:.2f}.mxn".format(costoMetroConstruccion)
Costo_de_venta_minima     = "Venta minima m2: ${:.2f}.mxn".format(Costo_de_venta_m2)

print("Venta m2 construccion: ${:.2f}".format(Costo_de_venta_m2))
print("Costo m2 construccion: ${:.2f}".format(costoMetroConstruccion))

costos_directos = (cus_area * costoMetroConstruccion) + total_dem + (cus_area * costoMetroConstruccion)
Costos_Directos = "Costos Directos: ${:.2f}.mxn".format(costos_directos)
print("Costos Directos: ${:.2f}".format(costos_directos))

area_com_est  = area_comercio + _am2_num
area_venta    = cus_area - area_com_est

precio_venta_total    = ((area_venta * Costo_de_venta_m2) + ingreso_local_tot) / cus_area
precio_venta_vivienda = (area_venta * Costo_de_venta_m2) / cus_area

print("Area de venta: {:.2f} m2".format(area_venta))
print("Precio venta total: ${:.2f}.mxn x m2".format(precio_venta_total))
print("Precio de venta de vivienda: ${:.2f}.mxn x m2".format(precio_venta_vivienda))

Area_de_Venta         = area_venta
Costo_de_Venta_total  = "Precio venta total: ${:.2f}.mxn x m2".format(precio_venta_total)
Precio_venta_vivienda = "Precio venta vivienda: ${:.2f}.mxn x m2".format(precio_venta_vivienda)

# Costos indirectos
honorarios_profesionales = costos_directos * 0.15
costos_legales           = precio_venta_total * 0.02
costos_administrativos   = precio_venta_total * 0.10
costos_financieros       = precio_venta_total * 0.03
costos_comerciales       = precio_venta_total * 0.06

print("Honorarios Profesionales (15%): ${:.2f}.mxn".format(honorarios_profesionales))
print("Costos Legales (2%): ${:.2f}".format(costos_legales))
print("Costos Administrativos (10%): ${:.2f}".format(costos_administrativos))
print("Costos Financieros (3%): ${:.2f}".format(costos_financieros))
print("Costos Comerciales (6%): ${:.2f}".format(costos_comerciales))

Honorarios_Profesionales = "Honorarios (15%): ${:.2f}.mxn".format(honorarios_profesionales)
Costos_Legales           = "Costos Legales (2%): ${:.2f}.mxn".format(costos_legales)
Costos_Administrativos   = "Costos Adm (10%): ${:.2f}.mxn".format(costos_administrativos)
Costos_Financieros       = "Costos Fin (3%): ${:.2f}.mxn".format(costos_financieros)
Costos_Comerciales       = "Costos Com (6%): ${:.2f}.mxn".format(costos_comerciales)

costos_indirectos = (
    honorarios_profesionales + costos_legales +
    costos_administrativos   + costos_financieros + costos_comerciales
)
Costos_Indirectos = "Costos Indirectos: ${:.2f}.mxn".format(costos_indirectos)
print("Costos Indirectos: ${:.2f}".format(costos_indirectos))

# ================================================================
# RENTABILIDAD CONSOLIDADA
# ================================================================
costo_total_construccion    = valor_terreno + costos_directos + costos_indirectos + sum(_costo_estac_num)
_costo_total_m2_num         = costo_total_construccion / cus_area
Costo_total_Construccion    = "Costo Total: ${:.2f}.mxn".format(costo_total_construccion)
Costo_total_Construccion_m2 = "Costo Total m2: ${:.2f}.mxn".format(_costo_total_m2_num)

print("Costo Total Construccion por m2: ${:.2f}".format(_costo_total_m2_num))
print("Costo Total Construccion: ${:.2f}".format(costo_total_construccion))

ingreso_total   = precio_venta_total + ingreso_local_tot if usos_mixtos else precio_venta_total
ganancia_bruta0 = ingreso_total - costo_total_construccion
ganancia_neta0  = ganancia_bruta0 * (IVA / 100.0)
utilidad0       = (ganancia_bruta0 / ingreso_total) * 100.0 if ingreso_total else 0.0

# ================================================================
# SIMULACIÓN DE UTILIDAD DESEADA
# ================================================================
def simulate_desired_utility(ingreso, costo, util_ini, util_meta,
                              incremento=1000000, max_iter=150000):
    precio      = ingreso
    ganancia    = ingreso - costo
    util_actual = util_ini
    iters       = 0
    while util_actual < util_meta and iters < max_iter:
        precio      += incremento
        ganancia     = precio - costo
        util_actual  = (ganancia / precio) * 100.0
        iters       += 1
        print("Iteracion {}: utilidad = {:.2f}%".format(iters, util_actual))
    return precio, ganancia, util_actual, iters

if correrSimulacion:
    nuevo_precio, nueva_ganancia, utilidad_final, total_iter = simulate_desired_utility(
        ingreso_total, costo_total_construccion, utilidad0, utilidadDeseada
    )
else:
    nuevo_precio   = ingreso_total
    nueva_ganancia = ganancia_bruta0
    utilidad_final = utilidad0
    total_iter     = 0

print("Nuevo Precio Venta Total: ${:.2f}".format(nuevo_precio))
print("Nueva Ganancia Bruta: ${:.2f}".format(nueva_ganancia))
print("Utilidad Final: {:.2f}%".format(utilidad_final))
print("Total Iteraciones: {}".format(total_iter))

Nuevo_Precio_venta   = "Nuevo Precio Venta Total: ${:.2f}".format(nuevo_precio)
Nueva_Ganancia_Bruta = "Nueva Ganancia Bruta: ${:.2f}".format(nueva_ganancia)
Utilidad_Final       = "Utilidad Final: {:.2f}%".format(utilidad_final)
Total_Inter          = "Total Iteraciones: {}".format(total_iter)

# ================================================================
# OUTPUTS ADICIONALES
# ================================================================
Costo_de_Vivienda = (area_venta / n_viviendas) * precio_venta_total if n_viviendas else 0.0
Area_departamento  = area_venta / n_viviendas if n_viviendas else 0.0

print("Costo de Vivienda: ${:.2f} mxn".format(Costo_de_Vivienda))
print("Area por Departamento: {:.2f} m2".format(Area_departamento))

# ================================================================
# EXPORTACIÓN CSV
# ================================================================
if Reporte_excel:
    ruta_carpeta = _s(ruta_carpeta)
    ruta_archivo = os.path.join(ruta_carpeta, "resultados_prefactibilidad.csv")

    def _jl(lst):
        try:    return " | ".join(str(x) for x in lst) if lst else "0"
        except: return str(lst)

    resultados = {
        "Area Terreno (m2)"                 : round(area_value, 2),
        "Valor del Terreno (MXN)"           : round(total_value, 2),
        "Area Neta (m2)"                    : round(area_neta, 2),
        "Costo Demolicion (MXN)"            : round(total_dem, 2),
        "Area COS (m2)"                     : round(cos_area, 2),
        "Area CAS (m2)"                     : round(cas_area, 2),
        "Area CUS (m2)"                     : round(cus_area, 2),
        "Numero de Niveles Vivienda"        : Num_Niveles,
        "Huella del Edificio (m2/nivel)"    : round(huella_edificio, 2),
        "Altura Total del Proyecto (mts)"   : round(Altura_Total_Proyecto, 2),
        "Estatus Huella vs COS"             : Huella_Estatus,
        "Area Circulacion (m2)"             : round(area_circulacion, 2),
        "Area Venta (m2)"                   : round(area_venta, 2),
        "Precio Venta Total (MXN/m2)"       : round(precio_venta_total, 2),
        "Precio Venta Vivienda (MXN/m2)"    : round(precio_venta_vivienda, 2),
        "Costo Vivienda (MXN)"              : round(Costo_de_Vivienda, 2),
        "Area por Departamento (m2)"        : round(Area_departamento, 2),
        "Area por Local (m2)"               : round(area_local, 2),
        "Venta por Local (MXN)"             : round(venta_local, 2),
        "Area Comercio (m2)"                : round(area_comercio, 2),
        "Estac. Cajones Vivienda"           : _jl(cajones_vivienda),
        "Estac. Cajones Comercio"           : _jl(cajones_comercio),
        "Estac. Cajones Totales"            : _jl(cajones_total),
        "Estac. Area total (m2)"            : _jl(area_m2),
        "Estac. Costo total (MXN)"          : _jl(costo_estac_total),
        "Honorarios Profesionales (MXN)"    : round(honorarios_profesionales, 2),
        "Costos Legales (MXN)"              : round(costos_legales, 2),
        "Costos Administrativos (MXN)"      : round(costos_administrativos, 2),
        "Costos Comerciales (MXN)"          : round(costos_comerciales, 2),
        "Costos Directos (MXN)"             : round(costos_directos, 2),
        "Costos Indirectos (MXN)"           : round(costos_indirectos, 2),
        "Costo Total Construccion (MXN)"    : round(costo_total_construccion, 2),
        "Costo Total Construccion (MXN/m2)" : round(_costo_total_m2_num, 2),
        "Utilidad Final (%)"                : round(utilidad_final, 2),
        "Nuevo Precio Venta Total (MXN)"    : round(nuevo_precio, 2),
        "Nueva Ganancia Bruta (MXN)"        : round(nueva_ganancia, 2),
        "Iteraciones Simulacion"            : total_iter,
    }

    try:
        with open(ruta_archivo, mode='w', newline='', encoding='utf-8') as f:
            w = csv.writer(f)
            w.writerow(["Variable", "Valor"])
            for k, v in resultados.items():
                w.writerow([k, v])
        print("Exportado en: " + ruta_archivo)
        ruta_csv      = ruta_archivo
        export_status = "Exportado correctamente"
    except Exception as e:
        ruta_csv      = "Error"
        export_status = "Error: {}".format(e)
    print("Estatus exportacion: " + export_status)
else:
    ruta_csv      = "Sin exportacion"
    export_status = "Exportacion desactivada"
    print("Estatus exportacion: " + export_status)
# ---------- end prefactibilidad_economica_mty_2025 ----------

# ---- group: Comprobación Altura Máxima
addition = Addition(
    AlturaDeUsosMixtos=altura_de_de_usos_mixtos,
    AlturaDeEstacionamiento=altura_entrepisos_estacionamiento,
    AlturaDeVivienda=altura_entrepisos_vivienda)
númer_de_niveles_por_sumatoria = Panel(addition)
altura_máxima = Panel(prefactibilidad_economica_mty_2025.Num_Niveles)
subtraction = Subtraction(A=númer_de_niveles_por_sumatoria, B=altura_máxima)
resultado = Panel(subtraction)

# ----
área_comercio = Panel(prefactibilidad_economica_mty_2025.area_comercio)

# ---- group: Condicionantes
panel_5 = Panel("Toma de Decisiones")

# ---- group: Data a Colocar
panel_6 = Panel("Data a recolectar")

# ----
integer = Integer(prefactibilidad_economica_mty_2025.Costo_de_Vivienda)
huella_estatus = Panel(prefactibilidad_economica_mty_2025.Huella_Estatus)
no_interacciones = Panel(prefactibilidad_economica_mty_2025.Total_Inter)
estatus_de_exporteción_de_excel = Panel(prefactibilidad_economica_mty_2025.export_status)
número_de_niveles = Panel(prefactibilidad_economica_mty_2025.Num_Niveles)
area_comercio = Panel(prefactibilidad_economica_mty_2025.area_comercio)
total_de_estacionamiento = Panel(prefactibilidad_economica_mty_2025.cajones_total)
utilidad_final = Panel(prefactibilidad_economica_mty_2025.costo_estac_total)
de_ganancia_bruta = Panel(prefactibilidad_economica_mty_2025.Nueva_Ganancia_Bruta)
costo_de_directos_totales = Panel(prefactibilidad_economica_mty_2025.Costos_Directos)
costos_indirectos = Panel(prefactibilidad_economica_mty_2025.Costos_Indirectos)
cajones_de_estacionamiento_vivienda = Panel(prefactibilidad_economica_mty_2025.cajones_vivienda)
cos_m2 = Panel(prefactibilidad_economica_mty_2025.COS_m2)
costo_de_venta = Panel(prefactibilidad_economica_mty_2025.Costo_de_Venta_total)
costo_de_venta_2 = Panel(prefactibilidad_economica_mty_2025.Precio_venta_vivienda)
honorarios_porfesionales = Panel(prefactibilidad_economica_mty_2025.Honorarios_Profesionales)
costos_legales = Panel(prefactibilidad_economica_mty_2025.Costos_Legales)
costos_financieros = Panel(prefactibilidad_economica_mty_2025.Costos_Financieros)
costo_total_por_m2_de_construccion = Panel(prefactibilidad_economica_mty_2025.Costo_total_Construccion_m2)
área_del_terreno = Panel(prefactibilidad_economica_mty_2025.Area_de_terreno)
valor_del_terreno_mxn = Panel(prefactibilidad_economica_mty_2025.Valor_del_terreno)
costo_de_venta_minima = Panel(prefactibilidad_economica_mty_2025.Costo_de_venta_minima)
cas_m2 = Panel(prefactibilidad_economica_mty_2025.CAS_m2)
costo_por_demilición = Panel(prefactibilidad_economica_mty_2025.Costo_de_demolicion)
cus_m2 = Panel(prefactibilidad_economica_mty_2025.CUS_m2)
huella_estatus_2 = Panel(prefactibilidad_economica_mty_2025.Altura_Total_str)
huella_edificio_m2 = Panel(prefactibilidad_economica_mty_2025.Huella_Edificio_m2)
ruta_donde_se_guardo_el_documento = Panel(prefactibilidad_economica_mty_2025.ruta_csv)
utilidad_final_2 = Panel(prefactibilidad_economica_mty_2025.Utilidad_Final)
cajones_de_estacionamiento_uso_mixto = Panel(prefactibilidad_economica_mty_2025.cajones_comercio)
total_de_estacionamiento_2 = Panel(prefactibilidad_economica_mty_2025.area_m2)
área_estaionamiento = Panel(total_de_estacionamiento_2)
volumetria_prefactibilidad_economica_mty = Python3Script(
    Num_Niveles=numero_de_niveles,
    crv_terreno=crv_terreno,
    Niveles_Comercio=niveles_comercio_2,
    usos_mixtos=comercio,
    COS=cos,
    CUS=cus,
    CAS=cas,
    estacionamiento_tipo=estacionamiento,
    area_estacionamiento=área_estaionamiento,
    area_usos_mixtos=área_comercio,
    altura_usos_mixtos=altura_de_de_usos_mixtos,
    altura_estacionamiento=altura_entrepisos_estacionamiento,
    altura_entrepisos_vivienda=altura_entrepisos_vivienda,
    frente=frente_de_terreno,
    remetimiento_frontal=remetimiento_frontal,
    remetimiento_posterior=remetimiento_posterior)  # -> out, area_terreno, superficie_terreno, area_COS, area_CUS, area_CAS, centroide_terreno, superficie_COS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; "VOLUMETRIA PREFACTIBILIDAD ECONOMICA MTY 2025"; inputs Num_Niveles: Int32, crv_terreno: Curve, Niveles_Comercio: Int32, usos_mixtos: Boolean, COS: Double, CUS: Double, CAS: Double, estacionamiento_tipo: String, area_estacionamiento: Double, area_usos_mixtos: Double, altura_usos_mixtos: Double, altura_entrepisos_vivienda: Double, frente: Curve, remetimiento_frontal: Int32, remetimiento_posterior: Int32
# ---------- volumetria_prefactibilidad_economica_mty: Python ----------
import Rhino
from Rhino.Geometry import (
    AreaMassProperties, Brep, Extrusion,
    Transform, Plane, Point3d, Vector3d, Line
)
import math
import scriptcontext as sc

# ================================================================
# DESEMPACADOR UNIVERSAL DE INPUTS DE GRASSHOPPER
# ================================================================
def _gh(v):
    if hasattr(v, 'Branches'):
        branches = list(v.Branches)
        if branches:
            branch = list(branches[0])
            if branch:
                v = branch[0]
    if isinstance(v, (list, tuple)):
        v = v[0]
    if hasattr(v, 'Value'):
        v = v.Value
    return v

def _f(v):  return float(_gh(v))
def _i(v):  return int(_gh(v))
def _b(v):
    val = _gh(v)
    if isinstance(val, bool):    return val
    if hasattr(val, '__bool__'): return bool(val)
    return bool(val)

def _sum_input(v):
    if hasattr(v, 'Branches'):
        total = 0.0
        for branch in v.Branches:
            for item in branch:
                try:    total += float(_gh(item))
                except: pass
        return total
    if isinstance(v, (list, tuple)):
        total = 0.0
        for x in v:
            try:    total += float(_gh(x))
            except: pass
        return total
    try:    return float(_gh(v))
    except: return 0.0

# ================================================================
# HELPERS DE EXTRUSIÓN — DIRECCIÓN EXPLÍCITA +Z o -Z
# ================================================================
def _normal_z(curve):
    ok, plane = curve.TryGetPlane(sc.doc.ModelAbsoluteTolerance)
    if ok:
        return plane.Normal.Z
    return 1.0

def _extrude_up(curve, height):
    h = abs(height)
    if _normal_z(curve) < 0:
        h = -h
    extr = Rhino.Geometry.Extrusion.Create(curve, h, True)
    return extr.ToBrep() if extr else None

def _extrude_down(curve, height):
    h = abs(height)
    if _normal_z(curve) >= 0:
        h = -h
    extr = Rhino.Geometry.Extrusion.Create(curve, h, True)
    return extr.ToBrep() if extr else None

# ================================================================
# HELPER REMETIMIENTO
# Crea una curva de huella reducida para niveles >= 5.
#
# Geometría:
#   front_normal = vector unitario perpendicular a 'frente',
#                  apuntando HACIA ADENTRO del lote.
#   frente_setback (m) = cuánto retrocede la cara frontal.
#   posterior_setback (m) = cuánto retrocede la cara posterior.
#
# Método (correcto para cualquier forma de planta):
#   1. Rotar curva para alinear front_normal con +X del mundo.
#   2. En ese espacio, obtener bounding box en X.
#   3. Escalar en X: new_depth = depth - (front + post).
#   4. Desplazar el centroide (front - post) / 2 hacia +X.
#   5. Rotar de vuelta.
#
# Verificación matemática:
#   - new_MinX = center_x - new_depth/2 + shift
#              = center_x - (d-9)/2 + 1.5
#              = MinX + 6  ✓
#   - new_MaxX = center_x + new_depth/2 + shift
#              = center_x + (d-9)/2 + 1.5
#              = MaxX - 3  ✓
# ================================================================
def _make_remetida(base_curve, front_normal, frente_setback, posterior_setback, centroide):
    """
    Devuelve una nueva curva con remetimiento asimétrico.
    front_normal: Vector3d unitario apuntando INWARD (desde calle hacia edificio).
    """
    nx = front_normal.X
    ny = front_normal.Y

    # Ángulo para rotar front_normal → eje +X
    angle = math.atan2(ny, nx)
    pivot = Point3d(centroide.X, centroide.Y, 0.0)

    # Rotar curva para alinear front con +X
    temp = base_curve.DuplicateCurve()
    xform_rot_fwd = Transform.Rotation(-angle, Vector3d(0, 0, 1), pivot)
    temp.Transform(xform_rot_fwd)

    # BBox en espacio rotado
    bbox  = temp.GetBoundingBox(True)
    depth = bbox.Max.X - bbox.Min.X  # profundidad en dirección frontal

    total_setback = frente_setback + posterior_setback
    if depth <= total_setback:
        print("AVISO: remetimiento ({:.1f}m) >= profundidad ({:.1f}m). Se usa huella sin remetir.".format(
            total_setback, depth))
        return base_curve.DuplicateCurve()

    new_depth  = depth - total_setback
    scale_x    = new_depth / depth

    # Centroide del bbox para escalar
    bbox_cx = (bbox.Min.X + bbox.Max.X) / 2.0
    bbox_cy = (bbox.Min.Y + bbox.Max.Y) / 2.0
    bbox_piv = Point3d(bbox_cx, bbox_cy, 0.0)

    # Escala no uniforme: X × scale_x, Y × 1.0
    xform_scale = Transform.Scale(
        Plane(bbox_piv, Vector3d(1, 0, 0), Vector3d(0, 1, 0)),
        scale_x, 1.0, 1.0
    )

    # Desplazamiento neto para compensar asimetría de setbacks:
    # (frente_setback - posterior_setback) / 2 en dirección +X (inward)
    shift_x   = (frente_setback - posterior_setback) / 2.0
    xform_shift = Transform.Translation(shift_x, 0.0, 0.0)

    # Rotar de vuelta
    xform_rot_bwd = Transform.Rotation(angle, Vector3d(0, 0, 1), pivot)

    # Aplicar transforms en orden
    new_crv = base_curve.DuplicateCurve()
    new_crv.Transform(xform_rot_fwd)
    new_crv.Transform(xform_scale)
    new_crv.Transform(xform_shift)
    new_crv.Transform(xform_rot_bwd)

    return new_crv

# ================================================================
# CONVERSIÓN DE TODOS LOS INPUTS
# ================================================================
COS                        = _f(COS)
CAS                        = _f(CAS)
CUS                        = _f(CUS)
Num_Niveles                = _i(Num_Niveles)
Niveles_Comercio           = _i(Niveles_Comercio)
altura_usos_mixtos         = abs(_f(altura_usos_mixtos))
altura_estacionamiento     = abs(_f(altura_estacionamiento))
altura_entrepisos_vivienda = abs(_f(altura_entrepisos_vivienda))
usos_mixtos                = _b(usos_mixtos)
area_estacionamiento       = _sum_input(area_estacionamiento)
estacionamiento_tipo       = str(_gh(estacionamiento_tipo)).strip()
remetimiento_frontal       = abs(_f(remetimiento_frontal))    # NEW — slider default 6.0
remetimiento_posterior     = abs(_f(remetimiento_posterior))  # NEW — slider default 3.0

# ================================================================
# VALIDACIONES
# ================================================================
if Num_Niveles <= 0:
    raise ValueError("Num_Niveles debe ser mayor a 0.")
if Niveles_Comercio <= 0:
    raise ValueError("Niveles_Comercio debe ser mayor a 0.")
if altura_usos_mixtos <= 0:
    raise ValueError("altura_usos_mixtos debe ser mayor a 0.")
if altura_entrepisos_vivienda <= 0:
    raise ValueError("altura_entrepisos_vivienda debe ser mayor a 0.")

# ================================================================
# ÁREA DEL TERRENO
# ================================================================
try:
    _crv              = _gh(crv_terreno)
    props             = AreaMassProperties.Compute(_crv)
    area_terreno      = props.Area
    centroide_terreno = props.Centroid
except Exception as e:
    raise ValueError("crv_terreno no es valido: {}".format(e))

breps = Brep.CreatePlanarBreps(_crv)
if not breps:
    raise ValueError("No se pudo generar superficie desde la curva")
superficie_terreno = breps[0]

# ================================================================
# NORMATIVA
# ================================================================
area_COS = area_terreno * COS
area_CAS = area_terreno * CAS
area_CUS = area_terreno * CUS
print("COS={:.2f} | CAS={:.2f} | CUS={:.2f} m2".format(area_COS, area_CAS, area_CUS))

# ================================================================
# PLANO BASE
# ================================================================
ok, base_plane = _crv.TryGetPlane(sc.doc.ModelAbsoluteTolerance)
if not ok:
    raise ValueError("La curva no es planar")
centroid_plane = Plane(centroide_terreno, base_plane.XAxis, base_plane.YAxis)
nz = base_plane.Normal.Z
print("Normal Z={:.3f} ({})".format(nz, "OK +Z" if nz >= 0 else "invertida, corrigiendo..."))

# ================================================================
# FRENTE — normal inward para remetimiento
# Input 'frente': una Line o Curve que marca el lindero frontal.
# front_normal = perpendicular a esa línea apuntando al centroide.
# ================================================================
try:
    _frente_raw = _gh(frente)

    # Obtener vector de dirección de la línea de frente
    if hasattr(_frente_raw, 'Direction'):
        # Es una Line nativa de Rhino
        frente_dir = Vector3d(_frente_raw.Direction)
    elif hasattr(_frente_raw, 'TangentAtStart'):
        # Es una Curve
        frente_dir = _frente_raw.TangentAtStart
    elif hasattr(_frente_raw, 'PointAtStart'):
        # Tiene puntos, calcular dirección
        p0 = _frente_raw.PointAtStart
        p1 = _frente_raw.PointAtEnd
        frente_dir = Vector3d(p1.X - p0.X, p1.Y - p0.Y, 0.0)
    else:
        raise ValueError("No se pudo leer la linea de frente")

    frente_dir.Z  = 0.0
    frente_dir.Unitize()

    # Perpendicular en el plano XY (rotar 90° en Z)
    perp_a = Vector3d(-frente_dir.Y,  frente_dir.X, 0.0)
    perp_b = Vector3d( frente_dir.Y, -frente_dir.X, 0.0)

    # Elegir la que apunta hacia el centroide (inward)
    cx = centroide_terreno.X
    cy = centroide_terreno.Y

    # Punto en la línea de frente
    if hasattr(_frente_raw, 'PointAtStart'):
        fp = _frente_raw.PointAtStart
    elif hasattr(_frente_raw, 'From'):
        fp = _frente_raw.From
    else:
        fp = Point3d(cx, cy, 0.0)

    to_centroid = Vector3d(cx - fp.X, cy - fp.Y, 0.0)

    dot_a = perp_a.X * to_centroid.X + perp_a.Y * to_centroid.Y
    front_normal = perp_a if dot_a >= 0 else perp_b
    front_normal.Unitize()

    print("front_normal = ({:.3f}, {:.3f}) — apunta hacia el edificio".format(
        front_normal.X, front_normal.Y))

    tiene_frente = True

except Exception as e:
    print("AVISO: no se pudo leer 'frente': {}. Remetimiento desactivado.".format(e))
    front_normal  = Vector3d(0, 1, 0)  # fallback
    tiene_frente  = False

# ================================================================
# CURVA COS (comercio)
# ================================================================
scale_factor_cos = math.sqrt(area_COS / area_terreno)
offset_curve_cos = _crv.DuplicateCurve()
offset_curve_cos.Transform(
    Transform.Scale(centroid_plane, scale_factor_cos, scale_factor_cos, scale_factor_cos)
)
breps_cos = Brep.CreatePlanarBreps(offset_curve_cos)
if not breps_cos:
    raise ValueError("No se pudo generar superficie COS")
superficie_COS = breps_cos[0]

# ================================================================
# SUPERFICIE CAS
# ================================================================
tol        = sc.doc.ModelAbsoluteTolerance
diff_breps = Brep.CreateBooleanDifference(superficie_COS, superficie_terreno, tol)
superficie_CAS = diff_breps[0] if diff_breps else None

# ================================================================
# CURVA HUELLA VIVIENDA — CUS / Num_Niveles
# ================================================================
huella_vivienda     = area_CUS / Num_Niveles
scale_factor_huella = math.sqrt(huella_vivienda / area_terreno)
offset_curve        = _crv.DuplicateCurve()
offset_curve.Transform(
    Transform.Scale(centroid_plane, scale_factor_huella, scale_factor_huella, scale_factor_huella)
)

# ================================================================
# CURVA REMETIDA — huella para nivel >= 5
# ================================================================
if tiene_frente:
    offset_curve_remetida = _make_remetida(
        offset_curve, front_normal,
        remetimiento_frontal, remetimiento_posterior,
        centroide_terreno
    )
    print("Remetimiento: frontal={:.1f}m | posterior={:.1f}m | aplica desde nivel 5".format(
        remetimiento_frontal, remetimiento_posterior))
else:
    offset_curve_remetida = offset_curve.DuplicateCurve()
    print("Remetimiento: no aplicado (falta input 'frente')")

# ================================================================
# HELPER: qué curva usar según nivel total
# nivel_total (1-indexed): 1 = primer piso global
# Remetimiento aplica cuando nivel_total >= 5
# ================================================================
NIVEL_REMETIMIENTO = 5

def _curva_para_nivel(nivel_total):
    if nivel_total >= NIVEL_REMETIMIENTO and tiene_frente:
        return offset_curve_remetida.DuplicateCurve()
    return offset_curve.DuplicateCurve()

# ================================================================
# ALTURA MÁXIMA NORMATIVA = 24m
# ================================================================
ALTURA_MAX_NORMATIVA = 24.0

# ================================================================
# VOLUMETRÍA COMERCIO
# ================================================================
volumetria_usos_mixtos = []
losas_usos_mixtos      = []
superficie_usos_mixtos = None
altura_total_comercio  = 0.0

if usos_mixtos:
    for i in range(Niveles_Comercio):
        nivel_total = i + 1
        z_losa      = float(i) * altura_usos_mixtos
        # Comercio usa COS completo; remetimiento aplica si llega al nivel 5
        if nivel_total >= NIVEL_REMETIMIENTO and tiene_frente:
            crv_base = _make_remetida(
                offset_curve_cos, front_normal,
                remetimiento_frontal, remetimiento_posterior,
                centroide_terreno
            )
        else:
            crv_base = offset_curve_cos.DuplicateCurve()

        moved_crv = crv_base
        moved_crv.Transform(Transform.Translation(0.0, 0.0, z_losa))
        losas_usos_mixtos.append(moved_crv)
        brep = _extrude_up(moved_crv, altura_usos_mixtos)
        if brep:
            volumetria_usos_mixtos.append(brep)

    altura_total_comercio = float(Niveles_Comercio) * altura_usos_mixtos
    if volumetria_usos_mixtos:
        superficie_usos_mixtos = volumetria_usos_mixtos[0]
    print("Comercio: {} niveles | Z=0 a Z={:.2f}".format(Niveles_Comercio, altura_total_comercio))
else:
    print("Comercio: desactivado")

# ================================================================
# VOLUMETRÍA ESTACIONAMIENTO
# ================================================================
volumetria_estacionamiento = []
losas_estacionamiento      = []
altura_total_est_niveles   = 0.0

print("Area estacionamiento: {:.2f} m2".format(area_estacionamiento))

if area_estacionamiento > 0:
    props_est     = AreaMassProperties.Compute(offset_curve)
    area_losa_est = props_est.Area if props_est else 0.0
    if area_losa_est <= 0:
        raise ValueError("area_losa_est es 0")

    n_losas_est       = int(math.floor(area_estacionamiento / area_losa_est))
    area_restante_est = area_estacionamiento - (n_losas_est * area_losa_est)

    if estacionamiento_tipo == "Estacionamiento Subterraneo":
        for i in range(n_losas_est):
            z_losa    = float(i) * (-altura_estacionamiento)
            moved_crv = offset_curve.DuplicateCurve()
            moved_crv.Transform(Transform.Translation(0.0, 0.0, z_losa))
            losas_estacionamiento.append(moved_crv)
            brep = _extrude_down(moved_crv, altura_estacionamiento)
            if brep:
                volumetria_estacionamiento.append(brep)
        if area_restante_est > 1e-3:
            sf_e     = math.sqrt(max(area_restante_est / area_losa_est, 1e-6))
            last_crv = offset_curve.DuplicateCurve()
            cp       = Point3d(centroide_terreno.X, centroide_terreno.Y, 0.0)
            last_crv.Transform(Transform.Scale(cp, sf_e))
            last_crv.Transform(Transform.Translation(0.0, 0.0, float(n_losas_est) * (-altura_estacionamiento)))
            losas_estacionamiento.append(last_crv)
            brep = _extrude_down(last_crv, altura_estacionamiento)
            if brep:
                volumetria_estacionamiento.append(brep)

    elif estacionamiento_tipo == "Estacionamiento en Niveles":
        base_z_est = altura_total_comercio
        for i in range(n_losas_est):
            z_losa    = base_z_est + float(i) * altura_estacionamiento
            moved_crv = offset_curve.DuplicateCurve()
            moved_crv.Transform(Transform.Translation(0.0, 0.0, z_losa))
            losas_estacionamiento.append(moved_crv)
            brep = _extrude_up(moved_crv, altura_estacionamiento)
            if brep:
                volumetria_estacionamiento.append(brep)
        if area_restante_est > 1e-3:
            sf_e     = math.sqrt(max(area_restante_est / area_losa_est, 1e-6))
            last_crv = offset_curve.DuplicateCurve()
            cp       = Point3d(centroide_terreno.X, centroide_terreno.Y, 0.0)
            last_crv.Transform(Transform.Scale(cp, sf_e))
            last_crv.Transform(Transform.Translation(0.0, 0.0, base_z_est + float(n_losas_est) * altura_estacionamiento))
            losas_estacionamiento.append(last_crv)
            brep = _extrude_up(last_crv, altura_estacionamiento)
            if brep:
                volumetria_estacionamiento.append(brep)
        n_gen                    = n_losas_est + (1 if area_restante_est > 1e-3 else 0)
        altura_total_est_niveles = float(n_gen) * altura_estacionamiento
    else:
        raise ValueError("estacionamiento_tipo no valido: '{}'".format(estacionamiento_tipo))

    print("Estacionamiento: {} Breps".format(len(volumetria_estacionamiento)))
else:
    print("Estacionamiento: area=0, sin volumetria")

# ================================================================
# VOLUMETRÍA VIVIENDA
# nivel_total para piso i de vivienda = Niveles_Comercio + i + 1
# Remetimiento aplica cuando nivel_total >= 5
# ================================================================
volumetria_vivienda = []
losas_vivienda      = []

z_inicial = altura_total_comercio
if estacionamiento_tipo == "Estacionamiento en Niveles" and area_estacionamiento > 0:
    z_inicial += altura_total_est_niveles

print("Vivienda empieza en Z={:.2f}".format(z_inicial))

for i in range(Num_Niveles):
    nivel_total = Niveles_Comercio + i + 1
    z_losa      = z_inicial + float(i) * altura_entrepisos_vivienda
    base_crv    = _curva_para_nivel(nivel_total)
    base_crv.Transform(Transform.Translation(0.0, 0.0, z_losa))
    losas_vivienda.append(base_crv)
    brep = _extrude_up(base_crv, altura_entrepisos_vivienda)
    if brep:
        volumetria_vivienda.append(brep)

altura_total_proyecto = z_inicial + float(Num_Niveles) * altura_entrepisos_vivienda
print("Vivienda: {} niveles | Z={:.2f} a Z={:.2f} | {} Breps".format(
    Num_Niveles, z_inicial, altura_total_proyecto, len(volumetria_vivienda)))

# ================================================================
# ALTURA_ESTATUS — incluye límite normativo de 24m
# ================================================================
total_niveles = Niveles_Comercio + Num_Niveles
lineas_estatus = []

# 1) Huella vs COS
if huella_vivienda > area_COS:
    niv_min = math.ceil(area_CUS / area_COS)
    lineas_estatus.append(
        "ADVERTENCIA HUELLA: {:.2f} m2 supera COS ({:.2f} m2). Minimo {} niveles.".format(
            huella_vivienda, area_COS, niv_min)
    )
else:
    pct = (huella_vivienda / area_COS) * 100
    lineas_estatus.append(
        "OK HUELLA: {:.2f} m2/nivel ({:.1f}% del COS) | {} niveles vivienda.".format(
            huella_vivienda, pct, Num_Niveles)
    )

# 2) Altura total vs 24m
if altura_total_proyecto > ALTURA_MAX_NORMATIVA:
    lineas_estatus.append(
        "ADVERTENCIA ALTURA: {:.2f} mts SUPERA el maximo normativo de {:.0f} mts.".format(
            altura_total_proyecto, ALTURA_MAX_NORMATIVA)
    )
else:
    margen = ALTURA_MAX_NORMATIVA - altura_total_proyecto
    lineas_estatus.append(
        "OK ALTURA: {:.2f} mts — dentro del maximo de {:.0f} mts. Margen: {:.2f} mts.".format(
            altura_total_proyecto, ALTURA_MAX_NORMATIVA, margen)
    )

# 3) Remetimiento
if tiene_frente:
    remetidos = [i for i in range(Num_Niveles) if (Niveles_Comercio + i + 1) >= NIVEL_REMETIMIENTO]
    if remetidos:
        lineas_estatus.append(
            "REMETIMIENTO: {} pisos con retroceso frontal {:.0f}m / posterior {:.0f}m (desde nivel {} en adelante).".format(
                len(remetidos), remetimiento_frontal, remetimiento_posterior, NIVEL_REMETIMIENTO)
        )
    else:
        lineas_estatus.append(
            "REMETIMIENTO: no aplica (proyecto tiene {} niveles totales, umbral es {}).".format(
                total_niveles, NIVEL_REMETIMIENTO)
        )
else:
    lineas_estatus.append("REMETIMIENTO: desactivado (conecta input 'frente').")

altura_estatus       = " | ".join(lineas_estatus)
altura_estatus_huella = lineas_estatus[0]  # compatibilidad con canvas anterior

print(altura_estatus)

# ================================================================
# SALIDAS — nombres sin cambio + nuevos marcados con NEW
# ================================================================
# area_terreno               float
# superficie_terreno         Brep
# centroide_terreno          Point3d
# area_COS / area_CAS / area_CUS  float
# superficie_COS             Brep
# superficie_CAS             Brep
# offset_curve_cos           Curve (COS, comercio)
# offset_curve               Curve (huella vivienda base)
# offset_curve_remetida      Curve (huella vivienda nivel >= 5)  NEW
# huella_vivienda            float m2/nivel
# altura_estatus             string (huella + 24m + remetimiento)  NEW (ampliado)
# altura_estatus_huella      string (solo huella, compatibilidad)
# altura_total_proyecto      float mts
# superficie_usos_mixtos     Brep
# volumetria_usos_mixtos     lista Breps
# losas_usos_mixtos          lista Curves
# volumetria_estacionamiento lista Breps
# losas_estacionamiento      lista Curves
# volumetria_vivienda        lista Breps  (pisos >= 5 con remetimiento)
# losas_vivienda             lista Curves
# ---------- end volumetria_prefactibilidad_economica_mty ----------
brep_estacionamiento_subterraneo = Brep(volumetria_prefactibilidad_economica_mty.volumetria_estacionamiento)

# ---- group: Comprobacion estacionmiento
sulección_de_superficie = Slider(2, range=0..10)
selección_de_superficie = Slider(4, range=0..6)
deconstruct_brep = DeconstructBrep(BrepESTACIONAMIENTO=brep_estacionamiento_subterraneo)  # -> Faces, Edges, Vertices
list_item = ListItem(List=deconstruct_brep.Faces, Index=selección_de_superficie, Wrap=True)
point_list = PointList(Points=deconstruct_brep.Vertices, Size=sulección_de_superficie)
superficie_estacionamiento = Surface(list_item)
area = Area(Geometry=superficie_estacionamiento)  # -> Area, Centroid
panel_7 = Panel(area.Area)
área_estaionamiento_2 = Panel(total_de_estacionamiento_2)
subtraction_2 = Subtraction(A=panel_7, B=área_estaionamiento_2)
panel_8 = Panel(subtraction_2)

# ---- group: Estacionamiento
colour_rgb = ColourRGB(Alpha=255, Red="150", Green="154", Blue="158")
custom_preview = CustomPreview(Geometry=brep_estacionamiento_subterraneo, Material=colour_rgb)

# ----
brep_usos_mixtos = Brep(volumetria_prefactibilidad_economica_mty.volumetria_usos_mixtos)

# ---- group: comprobación usos mixtos
selección_de_superficie_2 = Slider(4, range=0..6)
deconstruct_brep_2 = DeconstructBrep(BrepUSOSMIXTOS=brep_usos_mixtos)  # -> Faces, Edges, Vertices
list_item_2 = ListItem(List=deconstruct_brep_2.Faces, Index=selección_de_superficie_2, Wrap=True)
superficie_usos_mixtos = Surface(list_item_2)
area_2 = Area(Geometry=superficie_usos_mixtos)  # -> Area, Centroid
panel_9 = Panel(area_2.Area)
área_comercio_2 = Panel(prefactibilidad_economica_mty_2025.area_comercio)
subtraction_3 = Subtraction(A=panel_9, B=área_comercio_2)
panel_10 = Panel(subtraction_3)

# ---- group: Colo Usos MIXTOS
colour_rgb_2 = ColourRGB(Alpha=255, Red="150", Green="103", Blue="99")
custom_preview_2 = CustomPreview(Geometry=brep_usos_mixtos, Material=colour_rgb_2)

# ----
panel_11 = Panel(volumetria_prefactibilidad_economica_mty.offset_curve_cos)
área_cos = Panel(volumetria_prefactibilidad_economica_mty.area_COS)
área_de_terreno = Panel(volumetria_prefactibilidad_economica_mty.area_terreno)
área_cas = Panel(volumetria_prefactibilidad_economica_mty.area_CAS)
surface_cos = Surface(volumetria_prefactibilidad_economica_mty.superficie_COS)
curve_2 = Curve(volumetria_prefactibilidad_economica_mty.losas_estacionamiento)
curve_3 = Curve(volumetria_prefactibilidad_economica_mty.losas_vivienda)
brep_vivienda = Brep(volumetria_prefactibilidad_economica_mty.volumetria_vivienda)

# ---- group: Comprobacion vivienda
deconstruct_brep_3 = DeconstructBrep(BrepVIVIENDA=brep_vivienda)  # -> flatten(Faces), Edges, Vertices
list_item_3 = ListItem(List=deconstruct_brep_3.Faces, Index=Slider(4, range=0..6), Wrap=True)
list_item_4 = ListItem(List=deconstruct_brep_3.Faces, Index=Slider(10, range=0..12), Wrap=True)
superficie_de_vivienda = Surface(list_item_4)
superficie_vivienda = Surface(list_item_3)
area_3 = Area(Geometry=superficie_vivienda)  # -> Area, Centroid
area_4 = Area(Geometry=superficie_de_vivienda)  # -> Area, Centroid
panel_12 = Panel(area_3.Area)
panel_13 = Panel(area_4.Area)
addition_2 = Addition(A=panel_12, B=panel_13)
panel_14 = Panel(addition_2)
área_vivienda = Panel(prefactibilidad_economica_mty_2025.Area_de_Venta)
subtraction_4 = Subtraction(A=panel_14, B=área_vivienda)
panel_15 = Panel(subtraction_4)

# ---- group: Color Vivienda
colour_rgb_3 = ColourRGB(Alpha=255, Red="192", Green="196", Blue="188")
custom_preview_3 = CustomPreview(Geometry=brep_vivienda, Material=colour_rgb_3)

# ----
surface_cas = Surface(volumetria_prefactibilidad_economica_mty.superficie_CAS)

# ---- group: Superficies de CAS
colour_rgb_4 = ColourRGB(Alpha=255, Red="179", Green="178", Blue="143")
custom_preview_4 = CustomPreview(Geometry=surface_cas, Material=colour_rgb_4)

# ----
área_cus = Panel(volumetria_prefactibilidad_economica_mty.area_CUS)
lote = Surface(volumetria_prefactibilidad_economica_mty.superficie_terreno)
point = Point(volumetria_prefactibilidad_economica_mty.centroide_terreno)
estatus_de_altura_del_proyecto = Panel(volumetria_prefactibilidad_economica_mty.altura_estatus)
curve_4 = Curve(volumetria_prefactibilidad_economica_mty.losas_usos_mixtos)
ingreso_total_de_locales = Panel(prefactibilidad_economica_mty_2025.Ingreso_de_locales)
precio_de_venta = Panel(prefactibilidad_economica_mty_2025.Nuevo_Precio_venta)
costo_de_venta_por_departameto = Panel(integer)
area_del_departamento = Panel(prefactibilidad_economica_mty_2025.Area_departamento)
costos_administrativos = Panel(prefactibilidad_economica_mty_2025.Costos_Administrativos)
costos_comerciales = Panel(prefactibilidad_economica_mty_2025.Costos_Comerciales)
costo_final_de_construccion = Panel(prefactibilidad_economica_mty_2025.Costo_total_Construccion)
area_neta = Panel(prefactibilidad_economica_mty_2025.area_neta)
costo_por_m2_de_construccion = Panel(prefactibilidad_economica_mty_2025.Costo_por_m2_construccion)
area_de_venta_total = Panel(prefactibilidad_economica_mty_2025.Area_de_Venta)
venta_de_cada_local = Panel(prefactibilidad_economica_mty_2025.Venta_de_local)
area_de_locale_c_u = Panel(prefactibilidad_economica_mty_2025.Area_de_local)
información_generada = Panel(prefactibilidad_economica_mty_2025.out)

addition_3 = Addition(ÁreaEstacionamiento=área_estaionamiento, ÁreaUsosMixtos=área_comercio)
addition_4 = Addition(ResultadoEstacionamientoUsosMixtos=addition_3)
panel_16 = Panel(addition_3)
subtraction_5 = Subtraction(AreaMaximaDeConstrucción=área_cus, ResultadoEstacionamientoUsosMixtos=panel_16)
panel_17 = Panel(addition_4)
subtraction_6 = Subtraction(ÁreaMaximaDeConstrucción=área_cus, ResultadoDeSumatoriaDeÁreas=panel_17)

# ---- group: Area de Venta
panel_18 = Panel(subtraction_5)

# ---- group: Resultado de que estamos usando el maximo de Area Construible
panel_19 = Panel(subtraction_6)

# ----
division = Division(AreaDeVenta=panel_18, NúmeroDeDepartamentos=no_de_viviendas)

# ---- group: m2 por depa
panel_20 = Panel(division)

# ==== cluster DefiniciónTipoDeEstacionamiento: Este Script tpermiteelegir si el estacionamiento es Por Niveles o Subterraneo
tipo_de_estacionamiento = ClusterInput()

# ---- group: Tipo de Estacionamiento
panel = Panel("Estacionamiento Subterraneo")
panel_2 = Panel("Estacionamiento en Niveles")

# ----
tipo_de_estacionamiento_2 = Integer(tipo_de_estacionamiento)
merge = Merge(Data1=panel, Data2=panel_2)
item = ListItem(List=merge, Index=tipo_de_estacionamiento_2, Wrap=True)
tipo_de_estacionamiento_3 = Text(item)
tipo_de_estacionamiento_4 = ClusterOutput(tipo_de_estacionamiento_3)

# ==== cluster CostoPorM2DeConstruccion: En este Cluster encontraras el costo por m2 de construccion de Nuevo Leon, en el 2025
tipo_de_vivienda = ClusterInput()
porcentaje_de_indirectos = Panel(".28")
tipo_de_vivienda_2 = Integer(tipo_de_vivienda)
multiplication = Multiplication(A=tipo_de_vivienda, B=porcentaje_de_indirectos)
_28_de_indirectos = Addition(TipoDeVivienda=tipo_de_vivienda_2, B=multiplication)
costo_por_m2_de_construcción = Panel(_28_de_indirectos)
costo_por_m2_de_construccion = Integer(costo_por_m2_de_construcción)
costo_por_m2_de_construccion_2 = ClusterOutput(costo_por_m2_de_construccion)

# ==== cluster COEFICIENTESCOSCUSCAS: Este script tepermitira elegir la normativa correspondiente al distrito de tu terreno conforme al plan de desarrollo urbano de monterrey 2024
normativa = ClusterInput()
normativa_2 = Text(normativa)
split = TextSplit(Text=normativa_2, Separators="\"")
panel = Panel(split)
item = ListItem(List=split, Index="0", Wrap=True)
item_2 = ListItem(List=split, Index="1", Wrap=True)
item_3 = ListItem(List=split, Index="2", Wrap=True)
panel_2 = Panel(item_3)
panel_3 = Panel(item_2)
panel_4 = Panel(item)
cos = Number(panel_4)
cus = Number(panel_2)
cas = Number(panel_3)
cus_2 = ClusterOutput(cus)

# ---- group: Cluster Output
cos_2 = ClusterOutput(cos)

# ----
cas_2 = ClusterOutput(cas)

# ==== cluster InformaciónDeTerreno
parametro_retiros = ClusterInput()
curva_de_terreno = ClusterInput()
retiro_via = ClusterInput()
curva_de_terreno_2 = Curve(curva_de_terreno)
parametro_retiros_2 = Number(parametro_retiros)
retiro_via_2 = Number(retiro_via)
join_curves = JoinCurves(Curves=curva_de_terreno_2, Preserve=False)
crvlote = Curve(join_curves)
cluster = Cluster(crvlote=crvlote, paramento=parametro_retiros_2, retirovia=retiro_via_2)
boundary_surfaces = BoundarySurfaces(Edges=join_curves)
crvretiros = Curve(cluster)
area = Area(Geometry=boundary_surfaces)  # -> Area, Centroid
area_2 = Area(Geometry=crvretiros)  # -> Area, Centroid
panel = Panel(area.Area)
panel_2 = Panel(area_2.Area)
subtraction = Subtraction(A=panel, B=panel_2)
panel_3 = Panel(subtraction)
terreno = Surface(boundary_surfaces)
curva_de_retiros = Curve(crvretiros)
area_de_retiro = Number(panel_3)
terreno_2 = ClusterOutput(terreno)
curva_de_retiros_2 = ClusterOutput(curva_de_retiros)
area_de_retiro_2 = ClusterOutput(area_de_retiro)

# ==== cluster Cluster
crvlote = ClusterInput()
paramento = ClusterInput()
retirovia = ClusterInput()
crvlote_2 = Curve(crvlote)
paramento_2 = Integer(paramento)
retirovia_2 = Number(retirovia)
number_slider = Slider(10, range=0..10)
explode = Explode(Curve=crvlote_2, Recursive=True)  # -> Segments, Vertices
item = ListItem(List=explode.Segments, Index=paramento_2, Wrap=True)
neg = Negative(Value=retirovia_2)
boundary = BoundarySurfaces(Edges=crvlote_2)
ext = ExtendCurve(Curve=item, Type=0, Start=number_slider, End=number_slider)
offset = OffsetCurve(Curve=ext, Distance=neg, Corners=1)
srfsplit = SurfaceSplit(Surface=boundary, Curves=offset)
item_2 = ListItem(List=srfsplit, Index=0, Wrap=True)
edges = BrepEdges(Brep=item_2)  # -> Naked, Interior, NonManifold
join = JoinCurves(Curves=edges.Naked, Preserve=False)
crvlote_retiros = Curve(join)
crvlote_retiros_2 = ClusterOutput(crvlote_retiros)
